# Requirement set Geolocation (R2020b)

## 1 [Location] Must know where it is located
Must be able to locate itself in a pre-loaded map of a 3D space.

### 1.1 [Location of Charging pad] should know the location of the nearest charger.
The drone should always know the location of the nearest charging pad so that it can navigate to it when needed.

## 2 [3D Map Storaage]
Must be able to store a 3D map of the location in memory.