# Requirement set Platform (R2020b)

## 1 [Camera] HD Quality
Must have a good quality camera (720p)
Keywords: camera, good, like really good

### 1.1 [Additional Functions] extra camera abilities
Have infra-red, thermal and/or night-vision capabilities.

## 2 [Flight Time] At least 10mins
Must be able to fly continuously for at least 10 minutes, ideally longer.

## 3 [Size] Must be portable
must be easy to transport between locations.

## 4 [Cost] Must be kept low
Cost must be kept as low as possible.

## 5 [Set-Up] Must be easy
Drone cannot be complicated to set-up before use.

## 6 [Communication] Must have relevant communication tools.
Must be able to communicate with ground control and other drones via bluetooth/wifi/other communication methods.

### 6.1 [Processing Load] must be minimised
Processing done onboard the platform must be minimal to more efficiently use power, thereby increasing flight time.

## 7 [Obstacle sensor] for detecting new obstructions
Must have a device for sensing obstructions that are not present on pre-loaded 3D map.

## 8 [Weight] Less than 350g
Minimise as much as possible, ideally <350g.