% Requirement links of Alpha_Architecture.slx (R2020b)

model implements Platform.slreqx#2: Weight: Less than 350g
block :18 implements Platform.slreqx#9: Obstacle sensor: for detecting new obstructions
block :19 implements Platform.slreqx#5: Additional Functions: extra camera abilities
block :19 implements Platform.slreqx#1: Camera: HD Quality
block :20 implements Platform.slreqx#4: Size: Must be portable
block :26 implements Platform.slreqx#8: Communication: Must have relevant communication tools.
block :31 implements Platform.slreqx#3: Flight Time: At least 10mins
block :35 implements Flight Controller.slreqx#1: Performance: Must be fast and accurate
block :40 implements Flight Computer.slreqx#1: Override: must be able to take manual control
block :40 implements Flight Computer.slreqx#2: Manual Control
block :40 implements Platform.slreqx#10: Processing Load: must be minimised
block :97 implements Geolocation.slreqx#2: 3D Map Storaage
block :98 implements Geolocation.slreqx#1: Location: Must know where it is located
block :98 implements Geolocation.slreqx#3: Location of Charging pad: should know the location of the nearest charger.