% Simulink data dictionary Alpha_ArchitectureDD_1.sldd

Dynamic_States = Simulink.Bus()
  u: double
  v: double
  w: double
  p: double
  q: double
  r: double
  theta: double
  phi: double
  psi: double

Sensed_States = Simulink.Bus()
  u_m: double
  v_m: double
  w_m: double
  p_m: double
  q_m: double
  r_m: double
  theta_m: double
  phi_m: double
  psi_m: double

Thrusts = Simulink.Bus()
  T_fl: double
  T_fr: double
  T_bl: double
  T_br: double

Voltage_Variable = Simulink.Bus()
  dV_fl: double
  dV_fr: double
  dV_bl: double
  dV_br: double

States = Simulink.Bus()
Cmd = Simulink.Bus()